# Grasshopper definition Demo.gh (Grasshopper 1.0.7)
# plug-ins: ghWebSocket Info, GhGLTF Info

number_slider = Slider(1, range=0..100)
box = CenterBox(Base=PlaneXY(0, 0, 0), X=number_slider, Y=Slider(1, range=0..100), Z=1)
number_slider_2 = Slider(1, range=0..1)
mbox = MeshBox(Base=box, XCount=10, YCount=10, ZCount=10)
number_slider_3 = Slider(5, range=0..5)
sph = Sphere(Base=PlaneXY(0, 0, 0), Radius=number_slider)
websocket_client = WebSocketClient(Host="localhost", Port="8181", Reconnect=Button())
pop3d = Populate3D(Region=sph, Count=Slider(2160, range=1000..5000), Seed=Slider(100, range=0..100))  # -> flatten(Population)
path = FilePath("/Users/mnmly/Development-local/Personal/Projects/three-vr/demo.gltf")
socket_state = SocketState(Socket=websocket_client)
pt = Point([<point referenced from the Rhino model> x19])
crv = Curve(<curve referenced from the Rhino model>)
popgeo = PopulateGeometry(Geometry=sph, Count=100, Seed=1)  # -> flatten(Population)
panel = Panel(socket_state)
txt = Text(path)
pt_2 = ConstructPoint(XCoordinate=number_slider_3, YCoordinate=number_slider_3, ZCoordinate=number_slider_3)
merge = Merge(Data2=pt, Data3=popgeo, Data4=crv)
rep = ReplaceText(Text="{\"action\": \"broadcast\", \"data\": \"$data\"}", Find="$data", Replace=txt, RecursiveReplace=False)
export_gltf = ExportAsGlTF(Geometry=merge, OutputPath=path, FlipAxis=True, CurveResolutionFactor=0.2, Socket=websocket_client, SocketMessage=rep)
