# Grasshopper definition Demo_simple.gh (Grasshopper 1.0.7)
# plug-ins: Heteroptera, ghWebSocket Info, GhGLTF Info

number_slider = Slider(10, range=0..10)
center_box = CenterBox(Base=PlaneXY(0, 0, 0), X=1, Y=1, Z=1)
series = Series(Start=0, Step=Slider(3, range=0..10), Count=Slider(58, range=0..100))
point_emitter = PointEmitter(Emitter=PlaneXY(0, 0, 0), Radius=Domain(2, 10), Number=24, Tendency=0.25)
unit_z = UnitZ(Factor=series)  # -> graft(UnitVector)
unit_x = UnitX(Factor=series)
flatten_tree = FlattenTree(Tree=point_emitter, Path="{0}")
addition = Addition(A=unit_x, B=unit_z)  # -> flatten(Result)
mesh_brep = MeshBrep(
    Brep=center_box,
    Settings={GridMaxCount=0, GridMinCount=16, JaggedSeams=False, MaxEdgeLength=0, MinEdgeLength=0.0001, MinTolerance=0, Refine=True, RefineAngle=0, RelativeTolerance=0.65, SimplePlanes=True, Tolerance=0})
file_path = FilePath("/Users/mnmly/demo.gltf")
move = Move(Geometry=mesh_brep, Motion=addition)  # -> Geometry, Transform
curve = Curve([<curve referenced from the Rhino model> x2])
panel = Panel("/Users/mnmly/Downloads/out.glb")
file_path_2 = FilePath("/Users/mnmly/Development-local/Personal/Projects/three-vr/demo.gltf")
merge = Merge(Data1=move.Geometry, Data2=mesh_brep, Data3=flatten_tree)
websocket_client = WebSocketClient(Host="localhost", Port=Slider(8181, range=0..10000), Interval=1000)  # -> Socket, Message
websocket_state = WebSocketState(Socket=websocket_client.Socket)
websocket_state_2 = WebSocketState(Socket=websocket_client.Socket)
websocket_state_3 = WebSocketState(Socket=websocket_client.Socket)
panel_2 = Panel(websocket_state)
panel_3 = Panel(websocket_state_2)
panel_5 = Panel(websocket_state_3)
websocket_state_4 = WebSocketState(Socket=websocket_client.Socket)
export_as_gltf = ExportAsGlTF(Geometry=merge, OutputPath=file_path_2, FlipAxis=True, CurveResolutionFactor=0.2, Socket=websocket_client.Socket)
panel_8 = Panel(websocket_state_4)
